# Grasshopper definition Tower.gh (Grasshopper 1.0.8)
# plug-ins: Wombat

m_objects = QueryModelObjects(Layer="02_Tower_Base", Locked=True, Hidden=True, AutoUpdateState=True)
crv = Curve(m_objects)
explode = Explode(Curve=crv, Recursive=True)  # -> Segments, Vertices
area = Area(Geometry=crv)  # -> Area, Centroid
item = ListItem(List=explode.Segments, Index=0, Wrap=True)
mp = Midpoint(Curve=item)
ln = Line(StartPoint=area.Centroid, EndPoint=mp)
pl = ConstructPlane(Origin=area.Centroid, XAxis=ln, YAxis=Vector(0, 1, 0))
number_slider = Slider(19.8, range=15..30)
number_slider_2 = Slider(15, range=15..30)
dom = ConstructDomain(DomainStart=expr("-x", number_slider), DomainEnd=number_slider)
dom_2 = ConstructDomain(DomainStart=expr("-x", number_slider_2), DomainEnd=number_slider_2)
rectangle = Rectangle(Plane=pl, XSize=dom, YSize=dom_2, Radius=0)  # -> Rectangle, Length

bottom_width = Slider(0.81, range=0..1)
upper_width = Slider(0.563, range=0..1)
dom_3 = ConstructDomain(DomainStart=bottom_width, DomainEnd=upper_width)

ftf_height = Slider(3.8, range=2.9..5)
floor_count = Slider(36, range=5..70)
tower_twist = Slider(2.8, range=0..5)

# ---- group: TYPOLOGY MIX
coef_1 = Slider(0.856, range=0..1)
coef_2 = Slider(0.62, range=0..1)
coef_3 = Slider(0.236, range=0..1)
coef_4 = Slider(0, range=0..1)

# ----
series = Series(Start=0, Step=ftf_height, Count=floor_count)
series_2 = Series(Start=0, Step=tower_twist, Count=floor_count)
Z = UnitZ(Factor=series)
move = Move(Geometry=rectangle.Rectangle, Motion=Z)  # -> Geometry, Transform
area_2 = Area(Geometry=move.Geometry)  # -> Area, Centroid
lng = ListLength(List=area_2.Centroid)
range = Range(Domain=Domain(0, 1), Steps=expr("x-1", lng))
tower_deflection = GraphMapper(
    range,
    x0=0,
    x1=1,
    y0=0,
    y1=1,
    container_name="Bezier",
    cpx=[0, 0.738173306, 0.605435133, 1],
    cpy=[0.2548726201, 0.008803665638, 0.06793481112, 1])
crv_2 = Curve(move.Geometry)
remap = RemapNumbers(Value=tower_deflection, Source=Domain(0, 1), Target=dom_3)  # -> Mapped, Clipped
scale = Scale(Geometry=crv_2, Center=area_2.Centroid, Factor=remap.Mapped)  # -> Geometry, Transform
num = Number(series_2)
rotate = Rotate(Geometry=scale.Geometry, Angle=degrees(num), Plane=area_2.Centroid)  # -> Geometry, Transform
boundary = BoundarySurfaces(Edges=rotate.Geometry)
Z_2 = UnitZ(Factor=ftf_height)
extr = Extrude(Base=boundary, Direction=Z_2)
cluster = Cluster(V=coef_1, L=extr)
cluster_2 = Cluster(V=coef_2, L=extr)
cluster_3 = Cluster(V=coef_3, L=extr)
cluster_4 = Cluster(V=coef_4, L=extr)
py3 = Python3Script(data=extr, i1=cluster, i2=cluster_2, i3=cluster_3, i4=cluster_4)  # -> out1, out2, out3, out4; inputs data: list
# ---------- py3: Python ----------
indices = sorted([int(i1), int(i2), int(i3)])

indices = [max(0, min(len(data), i)) for i in indices]


out1 = data[:indices[0]]
out2 = data[indices[0]:indices[1]]
out3 = data[indices[1]:indices[2]]
out4 = data[indices[2]:]
# ---------- end py3 ----------
custom_preview = CustomPreview(Geometry=py3.out1, Material=ColourSwatch(SwatchColor=RGB(255, 94, 8)))
custom_preview_2 = CustomPreview(Geometry=py3.out2, Material=ColourSwatch(SwatchColor=RGB(181, 8, 255)))
custom_preview_3 = CustomPreview(Geometry=py3.out3, Material=ColourSwatch(SwatchColor=RGB(8, 94, 255)))
custom_preview_4 = CustomPreview(Geometry=py3.out4, Material=ColourSwatch(SwatchColor=RGB(255, 222, 8)))
data = Data(simplify(graft(extr)))
tstat = TreeStatistics(Tree=data)  # -> Paths, Length, Count
data_2 = Data(simplify(data))
debrep = DeconstructBrep(Brep=data_2)  # -> Faces, Edges, Vertices
panel = Panel("""Floor
Type
GFA
Facade Area""")
area_3 = Area(Geometry=debrep.Faces)  # -> Area, Centroid
pdecon = Deconstruct(Point=area_3.Centroid)  # -> XComponent, YComponent, ZComponent
join = TextJoin(Text=panel, Join="_")
lng_2 = ListLength(List=py3.out1)
lng_3 = ListLength(List=py3.out2)
lng_4 = ListLength(List=py3.out3)
lng_5 = ListLength(List=py3.out4)
sort = SortList(Keys=pdecon.ZComponent, ValuesA=debrep.Faces)  # -> Keys, ValuesA
dup = DuplicateData(Data=join, Number=tstat.Count, Order=True)  # -> graft(Data)
panel_2 = Panel("""0
-1""")
dup_2 = DuplicateData(Data="Retail", Number=lng_2, Order=True)
dup_3 = DuplicateData(Data="Office", Number=lng_3, Order=True)
dup_4 = DuplicateData(Data="Hospitality", Number=lng_4, Order=True)
dup_5 = DuplicateData(Data="Retai", Number=lng_5, Order=True)
item_2 = ListItem(List=sort.ValuesA, Index=0, Wrap=True)  # -> simplify(Item)
cull_i = CullIndex(List=sort.ValuesA, Indices=panel_2, Wrap=True)
tstat_2 = TreeStatistics(Tree=data_2)  # -> Paths, Length, Count
split = TextSplit(Text=dup, Separators="_")  # -> simplify(Result)
merge = Merge(Data1=dup_2, Data2=dup_3, Data3=dup_4, Data4=dup_5)  # -> graft(Result)
area_4 = Area(Geometry=cull_i)  # -> Area, Centroid
data_3 = Data(split)
series_3 = Series(Start=0, Step=1, Count=tstat_2.Count)  # -> graft(Series)
ma = MassAddition(Input=area_4.Area)  # -> simplify(Result), PartialResults
area_5 = Area(Geometry=item_2)  # -> Area, Centroid
int = Integer(area_5.Area)
int_2 = Integer(ma.Result)
merge_2 = Merge(Data1=simplify(series_3), Data2=simplify(merge), Data3=simplify(int), Data4=simplify(int_2))
ma_2 = MassAddition(Input=flatten(area_5.Area))  # -> Result, PartialResults
panel_3 = Panel(data_3)
panel_4 = Panel(merge_2)
panel_5 = Panel(ma_2.Result)
py3_2 = Python3Script(keys=panel_3, values=panel_4, filePath="C:\Users\mscigaj\Desktop\Work\00_Hackhathon\data.json", write=Button())  # -> a, b; inputs keys: tree, values: tree
# ---------- py3_2: Python ----------
import json
import os

# build result (your existing logic)
result = []

branch_count = min(keys.BranchCount, values.BranchCount)

for i in range(branch_count):
    k_branch = keys.Branch(i)
    v_branch = values.Branch(i)

    d = {}
    item_count = min(len(k_branch), len(v_branch))

    for j in range(item_count):
        k = str(k_branch[j])
        v = v_branch[j]

        try:
            if "." in str(v):
                v = float(v)
            else:
                v = int(v)
        except:
            v = str(v)

        d[k] = v

    result.append(d)

# convert to json
jsonText = json.dumps(result, indent=2)

path = str(filePath).strip()

if write and path:

    folder = os.path.dirname(path)

    if folder != "" and not os.path.exists(folder):
        os.makedirs(folder)

    with open(path, "w") as f:
        f.write(jsonText)

# outputs
a = jsonText
b = result
c = path
# ---------- end py3_2 ----------

# ==== cluster Cluster
L = ClusterInput()
lng = ListLength(List=L)
V = ClusterInput()
dom = ConstructDomain(DomainStart=0, DomainEnd=lng)
remap = RemapNumbers(Value=V, Source=Domain(0, 1), Target=dom)  # -> Mapped, Clipped
int = Integer(remap.Mapped)
int_2 = ClusterOutput(int)
